# Grasshopper definition pernilles syke greie.gh (Grasshopper 0.9.76)

number_slider = Slider(10, range=0..10)
curve = Curve(<curve referenced from the Rhino model>)
polygon = Polygon(
    Plane=PlaneXY(0, 0, 0),
    Radius=Slider(85, range=0..100),
    Segments=Slider(5, range=0..10),
    FilletRadius=Slider(0, range=0..10))  # -> Polygon, Length
divide_curve = DivideCurve(Curve=curve, Count=number_slider, Kinks=False)  # -> Points, Tangents, Parameters
series = Series(Start=Slider(71, range=0..100), Step=Slider(5, range=0..10), Count=number_slider)
move = Move(Geometry=polygon.Polygon, Motion=divide_curve.Points)  # -> Geometry, Transform
panel = Panel(series)
rotate = Rotate(Geometry=move.Geometry, Angle=series, Plane=PlaneXY(0, 0, 0))  # -> Geometry, Transform
loft = Loft(Curves=rotate.Geometry, Options={Adjust=False, Closed=False, LoftEnds=0, LoftSimp=0, LoftType=0, Rebuild=10, Refit=0.01})
